# Grasshopper definition Timber-preview.ghx (Grasshopper 1.0.8)
# plug-ins: Woodie

# ---- group: 01 / Cutting
# 01 / CUT THROUGH THE STOCK
# Move Position and Angle to expose the interior. Keep Positive reverses the retained side.
# The original stock fixes the knot field; Cut outputs document units. Preview uses Document.
# Right-click Preview > Bake for native textured geometry. Save textures in the 3dm.
# Cut controls
# Retain side
# Construct the plane
# 1200 × 300 × 120 mm
# Appearance
original_stock_mm = Geometry(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)
# WOODIE / TIMBER PLAYGROUND
# 01 Cut through the stock     02 Follow a knot     03 Build your own stack     04 Product library     05 Rotated tower     06 Natural bamboo
# Start with the demonstrations below. Open a material's arrow for its controls.
# Units are handled by the definition · 1 mm/pixel · input geometry stays unchanged.
# Procedural appearance inspired by Larsson et al. (2022), DOI 10.1145/3528223.3530081.
# 04 / PRODUCT LIBRARY
# Eight products × eleven geometry cases. Use each card's Show toggle to reveal it in the viewport.
# Turn one product on at a time for close inspection; the numbered demonstrations stay visible. Shared input wires appear when selected.
position = Slider(50, range=0..100)
angle_degrees = Slider(0, range=-75..75)
multiplication = Multiplication(A=position, B=12)
pt = ConstructPoint(XCoordinate=multiplication, YCoordinate=150, ZCoordinate=60)
rad = Radians(Degrees=angle_degrees)
cos = Cosine(Value=rad)
sin = Sine(Value=rad)
vec = VectorXYZ(XComponent=cos, YComponent=0, ZComponent=sin)  # -> Vector, Length
pl = PlaneNormal(Origin=pt, ZAxis=vec.Vector)
cutting_material = TimberMaterial(Seed=3, Resolution=1, Advanced=False, PanelExpanded=False, SelectedLook=0, SelectedProduct=5, WoodieMaterialVersion=3)  # -> Settings, Product
keep_positive = BooleanToggle(False)
timbercut = TimberCut(Geometry=original_stock_mm, CuttingPlane=pl, KeepPositive=keep_positive, GeometryUnits="Millimetres")  # -> Geometry, StockGeometry, SectionOutlines, StockModel
cutting_plane_outline = Curve(timbercut.SectionOutlines)
cutting_preview = TimberPreview(
    Geometry=timbercut.Geometry,
    Settings=cutting_material.Settings,
    BasePlane=PlaneXY(0, 0, 0),
    Show=True,
    StockGeometry=timbercut.StockGeometry)  # -> Meshes, Products, AlignedBox, Frame

# ---- group: 02 / Knot cutaway
# 02 / FOLLOW A KNOT
# One connected piece; terraces at 120 / 80 / 40 mm.
# Move Knot section to expose a capped cross-section.
# Automatic seed 3; the uncut stepped stock fixes the grain.
# Stepped solid / mm
# Natural / seed 3
uncut_stepped_stock_mm = Geometry(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)
knot_section = Slider(70, range=0..100)
multiplication_2 = Multiplication(A=knot_section, B=12)
pt_2 = ConstructPoint(XCoordinate=multiplication_2, YCoordinate=800, ZCoordinate=60)
pl_2 = PlaneNormal(Origin=pt_2, ZAxis=Vector(1, 0, 0))
knot_section_2 = TimberCut(Geometry=uncut_stepped_stock_mm, CuttingPlane=pl_2, KeepPositive=False, GeometryUnits="Millimetres")  # -> Geometry, StockGeometry, SectionOutlines, StockModel
knot_section_outline = Curve(knot_section_2.SectionOutlines)
cutaway_material = TimberMaterial(Seed=3, Resolution=1, Advanced=False, PanelExpanded=False, SelectedLook=0, SelectedProduct=5, WoodieMaterialVersion=3)  # -> Settings, Product
cutaway_preview = TimberPreview(
    Geometry=knot_section_2.Geometry,
    Settings=cutaway_material.Settings,
    BasePlane=PlaneXY(0, 0, 0),
    Show=True,
    StockGeometry=knot_section_2.StockGeometry)  # -> Meshes, Products, AlignedBox, Frame

# ---- group: 05 / Rotated tower
# 05 / ROTATED TOWER
# Straight timber slats between two rings; the top ring is twisted so the generators form a hyperboloid waist.
# Each slat is item-matched through Preview; fibre follows the long axis. See 06 for natural bamboo. Right-click Preview > Bake for native textured geometry.
# 16 slats · 100 × 40 mm · Solid timber
slats = TowerSlatsMm([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])
tower_material = TimberMaterial(Seed=3, Resolution=8, Advanced=False, PanelExpanded=False, SelectedLook=0, SelectedProduct=5, WoodieMaterialVersion=3)  # -> Settings, Product
tower_preview = TimberPreview(Geometry=slats, Settings=tower_material.Settings, Show=True, GeometryUnits="Millimetres")  # -> Meshes, Products, AlignedBox, Frame

# ---- group: 03 / Custom buildup
# 03 / BUILD YOUR OWN STACK
# Layer → Buildup → Preview. Stack order is bottom to top.
# Exact 30 / 60 cross / 30 mm; enable Fit only to scale proportions.
# Appearance
# Bottom / 30 mm
# Cross core / 60 mm
# Top / 30 mm
# 120 mm stock / mm
# Resolved schedule
# Section diagram output
# Preview hidden; isolate it for inspection.
stock = CustomBuildupStock(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)
buildup_material = TimberMaterial(Seed=0, Resolution=1, Advanced=False, PanelExpanded=False, SelectedLook=1, SelectedProduct=0, WoodieMaterialVersion=3)  # -> Settings, Product
timberlayer = TimberLayer(Thickness=30, Direction=0, Construction=1, BoardWidth=150, EndJoints=0)  # -> Layer, Description
timberlayer_2 = TimberLayer(Thickness=60, Direction=1, Construction=1, BoardWidth=150, EndJoints=0)  # -> Layer, Description
timberlayer_3 = TimberLayer(Thickness=30, Direction=0, Construction=1, BoardWidth=150, EndJoints=0)  # -> Layer, Description
timberbuildup = TimberBuildup(
    Settings=buildup_material.Settings,
    Layers=[timberlayer.Layer, timberlayer_2.Layer, timberlayer_3.Layer],
    FitToPart=False)  # -> Settings, Layers, Thickness, Schedule, SectionDiagram
section_diagram = Curve(timberbuildup.SectionDiagram)
custom_buildup = TimberPreview(Geometry=stock, Settings=timberbuildup.Settings, BasePlane=PlaneXY(0, 0, 0), Show=True, GeometryUnits="Millimetres")  # -> Meshes, Products, AlignedBox, Frame
layer_schedule = Panel(timberbuildup.Schedule)

# ---- group: 04 / Product library / Library / Solid timber
# Solid timber
# 120 mm · Clean/Pale · 1 mm/pixel
# Material
# Source coordinates
# 01 Solid Brep
# 02 Extrusion
# 03 Surface
# 04 Closed mesh
# 05 Open mesh
# 06 Trimmed + hole
# 07 Bowed surface
# 08 Bowed Brep
# 09 Guided solid
# 10 Guided extrusion
# 11 Guided mesh
millimetres = SourceCoordinateUnits("Millimetres")
geometry = SolidTimber01FlatSolidBrepMatchedLength(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)
geometry_2 = SolidTimber02Extrusion(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)
geometry_3 = SolidTimber03FlatSurface(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)
geometry_4 = SolidTimber04ClosedMesh(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)
geometry_5 = SolidTimber05OpenMesh(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)
geometry_6 = SolidTimber06TrimmedSurfaceWithHole(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)
geometry_7 = SolidTimber07BowedSurfaceAutomatic(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)
geometry_8 = SolidTimber08BowedSingleFaceBrepAutomatic(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)
geometry_9 = SolidTimber09BowedSolidBrepGuide(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)
guide = SolidTimber09BowedSolidBrepGuideGuide(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)
geometry_10 = SolidTimber10BowedExtrusionGuide(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)
guide_2 = SolidTimber10BowedExtrusionGuideGuide(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)
geometry_11 = SolidTimber11BowedMeshGuide(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)
guide_3 = SolidTimber11BowedMeshGuideGuide(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)
library_solid_timber = TimberMaterial(Seed=0, Resolution=1, Advanced=False, PanelExpanded=False, SelectedLook=1, SelectedProduct=5, WoodieMaterialVersion=3)  # -> Settings, Product
show_solid_timber = BooleanToggle(False)
solid_timber_01_flat_solid_brep_matched = TimberPreview(Geometry=geometry, Settings=library_solid_timber.Settings, Show=show_solid_timber, GeometryUnits=millimetres)  # -> Meshes, Products, AlignedBox, Frame; "Solid timber / 01 Flat solid Brep (matched length)"
solid_timber_02_extrusion = TimberPreview(Geometry=geometry_2, Settings=library_solid_timber.Settings, Show=show_solid_timber, GeometryUnits=millimetres)  # -> Meshes, Products, AlignedBox, Frame
solid_timber_03_flat_surface = TimberPreview(Geometry=geometry_3, Settings=library_solid_timber.Settings, Show=show_solid_timber, GeometryUnits=millimetres)  # -> Meshes, Products, AlignedBox, Frame
solid_timber_04_closed_mesh = TimberPreview(Geometry=geometry_4, Settings=library_solid_timber.Settings, Show=show_solid_timber, GeometryUnits=millimetres)  # -> Meshes, Products, AlignedBox, Frame
solid_timber_05_open_mesh = TimberPreview(Geometry=geometry_5, Settings=library_solid_timber.Settings, Show=show_solid_timber, GeometryUnits=millimetres)  # -> Meshes, Products, AlignedBox, Frame
solid_timber_06_trimmed_surface_with_hol = TimberPreview(Geometry=geometry_6, Settings=library_solid_timber.Settings, Show=show_solid_timber, GeometryUnits=millimetres)  # -> Meshes, Products, AlignedBox, Frame; "Solid timber / 06 Trimmed surface with hole"
solid_timber_07_bowed_surface_automatic = TimberPreview(Geometry=geometry_7, Settings=library_solid_timber.Settings, Show=show_solid_timber, GeometryUnits=millimetres)  # -> Meshes, Products, AlignedBox, Frame
solid_timber_08_bowed_single_face_brep_a = TimberPreview(Geometry=geometry_8, Settings=library_solid_timber.Settings, Show=show_solid_timber, GeometryUnits=millimetres)  # -> Meshes, Products, AlignedBox, Frame; "Solid timber / 08 Bowed single-face Brep - automatic"
solid_timber_09_bowed_solid_brep_guide = TimberPreview(
    Geometry=geometry_9,
    Settings=library_solid_timber.Settings,
    BasePlane=PlaneXY(0, 0, 0),
    GuideCurve=guide,
    Show=show_solid_timber,
    GeometryUnits=millimetres)  # -> Meshes, Products, AlignedBox, Frame
solid_timber_10_bowed_extrusion_guide = TimberPreview(
    Geometry=geometry_10,
    Settings=library_solid_timber.Settings,
    BasePlane=PlaneXY(0, 0, 0),
    GuideCurve=guide_2,
    Show=show_solid_timber,
    GeometryUnits=millimetres)  # -> Meshes, Products, AlignedBox, Frame
solid_timber_11_bowed_mesh_guide = TimberPreview(
    Geometry=geometry_11,
    Settings=library_solid_timber.Settings,
    BasePlane=PlaneXY(0, 0, 0),
    GuideCurve=guide_3,
    Show=show_solid_timber,
    GeometryUnits=millimetres)  # -> Meshes, Products, AlignedBox, Frame

# ---- group: 04 / Product library / Library / KVH
# KVH
# 120 mm · Clean/Pale · 1 mm/pixel
# Material
# Source coordinates
# 01 Solid Brep
# 02 Extrusion
# 03 Surface
# 04 Closed mesh
# 05 Open mesh
# 06 Trimmed + hole
# 07 Bowed surface
# 08 Bowed Brep
# 09 Guided solid
# 10 Guided extrusion
# 11 Guided mesh
millimetres_2 = SourceCoordinateUnits("Millimetres")
geometry_12 = KVH01FlatSolidBrepMatchedLength(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)
geometry_13 = KVH02Extrusion(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)
geometry_14 = KVH03FlatSurface(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)
geometry_15 = KVH04ClosedMesh(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)
geometry_16 = KVH05OpenMesh(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)
geometry_17 = KVH06TrimmedSurfaceWithHole(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)
geometry_18 = KVH07BowedSurfaceAutomatic(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)
geometry_19 = KVH08BowedSingleFaceBrepAutomatic(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)
geometry_20 = KVH09BowedSolidBrepGuide(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)
guide_4 = KVH09BowedSolidBrepGuideGuide(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)
geometry_21 = KVH10BowedExtrusionGuide(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)
guide_5 = KVH10BowedExtrusionGuideGuide(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)
geometry_22 = KVH11BowedMeshGuide(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)
guide_6 = KVH11BowedMeshGuideGuide(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)
library_kvh = TimberMaterial(Seed=0, Resolution=1, Advanced=False, PanelExpanded=False, SelectedLook=1, SelectedProduct=4, WoodieMaterialVersion=3)  # -> Settings, Product
show_kvh = BooleanToggle(False)
kvh_01_flat_solid_brep_matched_length = TimberPreview(Geometry=geometry_12, Settings=library_kvh.Settings, Show=show_kvh, GeometryUnits=millimetres_2)  # -> Meshes, Products, AlignedBox, Frame
kvh_02_extrusion = TimberPreview(Geometry=geometry_13, Settings=library_kvh.Settings, Show=show_kvh, GeometryUnits=millimetres_2)  # -> Meshes, Products, AlignedBox, Frame
kvh_03_flat_surface = TimberPreview(Geometry=geometry_14, Settings=library_kvh.Settings, Show=show_kvh, GeometryUnits=millimetres_2)  # -> Meshes, Products, AlignedBox, Frame
kvh_04_closed_mesh = TimberPreview(Geometry=geometry_15, Settings=library_kvh.Settings, Show=show_kvh, GeometryUnits=millimetres_2)  # -> Meshes, Products, AlignedBox, Frame
kvh_05_open_mesh = TimberPreview(Geometry=geometry_16, Settings=library_kvh.Settings, Show=show_kvh, GeometryUnits=millimetres_2)  # -> Meshes, Products, AlignedBox, Frame
kvh_06_trimmed_surface_with_hole = TimberPreview(Geometry=geometry_17, Settings=library_kvh.Settings, Show=show_kvh, GeometryUnits=millimetres_2)  # -> Meshes, Products, AlignedBox, Frame
kvh_07_bowed_surface_automatic = TimberPreview(Geometry=geometry_18, Settings=library_kvh.Settings, Show=show_kvh, GeometryUnits=millimetres_2)  # -> Meshes, Products, AlignedBox, Frame
kvh_08_bowed_single_face_brep_automatic = TimberPreview(Geometry=geometry_19, Settings=library_kvh.Settings, Show=show_kvh, GeometryUnits=millimetres_2)  # -> Meshes, Products, AlignedBox, Frame
kvh_09_bowed_solid_brep_guide = TimberPreview(
    Geometry=geometry_20,
    Settings=library_kvh.Settings,
    BasePlane=PlaneXY(0, 0, 0),
    GuideCurve=guide_4,
    Show=show_kvh,
    GeometryUnits=millimetres_2)  # -> Meshes, Products, AlignedBox, Frame
kvh_10_bowed_extrusion_guide = TimberPreview(
    Geometry=geometry_21,
    Settings=library_kvh.Settings,
    BasePlane=PlaneXY(0, 0, 0),
    GuideCurve=guide_5,
    Show=show_kvh,
    GeometryUnits=millimetres_2)  # -> Meshes, Products, AlignedBox, Frame
kvh_11_bowed_mesh_guide = TimberPreview(
    Geometry=geometry_22,
    Settings=library_kvh.Settings,
    BasePlane=PlaneXY(0, 0, 0),
    GuideCurve=guide_6,
    Show=show_kvh,
    GeometryUnits=millimetres_2)  # -> Meshes, Products, AlignedBox, Frame

# ---- group: 04 / Product library / Library / Glulam
# Glulam
# 120 mm · Clean/Pale · 1 mm/pixel
# Material
# Source coordinates
# 01 Solid Brep
# 02 Extrusion
# 03 Surface
# 04 Closed mesh
# 05 Open mesh
# 06 Trimmed + hole
# 07 Bowed surface
# 08 Bowed Brep
# 09 Guided solid
# 10 Guided extrusion
# 11 Guided mesh
millimetres_3 = SourceCoordinateUnits("Millimetres")
geometry_23 = Glulam01FlatSolidBrepMatchedLength(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)
geometry_24 = Glulam02Extrusion(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)
geometry_25 = Glulam03FlatSurface(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)
geometry_26 = Glulam04ClosedMesh(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)
geometry_27 = Glulam05OpenMesh(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)
geometry_28 = Glulam06TrimmedSurfaceWithHole(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)
geometry_29 = Glulam07BowedSurfaceAutomatic(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)
geometry_30 = Glulam08BowedSingleFaceBrepAutomatic(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)
geometry_31 = Glulam09BowedSolidBrepGuide(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)
guide_7 = Glulam09BowedSolidBrepGuideGuide(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)
geometry_32 = Glulam10BowedExtrusionGuide(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)
guide_8 = Glulam10BowedExtrusionGuideGuide(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)
geometry_33 = Glulam11BowedMeshGuide(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)
guide_9 = Glulam11BowedMeshGuideGuide(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)
library_glulam = TimberMaterial(Seed=0, Resolution=1, Advanced=False, PanelExpanded=False, SelectedLook=1, SelectedProduct=2, WoodieMaterialVersion=3)  # -> Settings, Product
show_glulam = BooleanToggle(False)
glulam_01_flat_solid_brep_matched_length = TimberPreview(Geometry=geometry_23, Settings=library_glulam.Settings, Show=show_glulam, GeometryUnits=millimetres_3)  # -> Meshes, Products, AlignedBox, Frame
glulam_02_extrusion = TimberPreview(Geometry=geometry_24, Settings=library_glulam.Settings, Show=show_glulam, GeometryUnits=millimetres_3)  # -> Meshes, Products, AlignedBox, Frame
glulam_03_flat_surface = TimberPreview(Geometry=geometry_25, Settings=library_glulam.Settings, Show=show_glulam, GeometryUnits=millimetres_3)  # -> Meshes, Products, AlignedBox, Frame
glulam_04_closed_mesh = TimberPreview(Geometry=geometry_26, Settings=library_glulam.Settings, Show=show_glulam, GeometryUnits=millimetres_3)  # -> Meshes, Products, AlignedBox, Frame
glulam_05_open_mesh = TimberPreview(Geometry=geometry_27, Settings=library_glulam.Settings, Show=show_glulam, GeometryUnits=millimetres_3)  # -> Meshes, Products, AlignedBox, Frame
glulam_06_trimmed_surface_with_hole = TimberPreview(Geometry=geometry_28, Settings=library_glulam.Settings, Show=show_glulam, GeometryUnits=millimetres_3)  # -> Meshes, Products, AlignedBox, Frame
glulam_07_bowed_surface_automatic = TimberPreview(Geometry=geometry_29, Settings=library_glulam.Settings, Show=show_glulam, GeometryUnits=millimetres_3)  # -> Meshes, Products, AlignedBox, Frame
glulam_08_bowed_single_face_brep_automat = TimberPreview(Geometry=geometry_30, Settings=library_glulam.Settings, Show=show_glulam, GeometryUnits=millimetres_3)  # -> Meshes, Products, AlignedBox, Frame; "Glulam / 08 Bowed single-face Brep - automatic"
glulam_09_bowed_solid_brep_guide = TimberPreview(
    Geometry=geometry_31,
    Settings=library_glulam.Settings,
    BasePlane=PlaneXY(0, 0, 0),
    GuideCurve=guide_7,
    Show=show_glulam,
    GeometryUnits=millimetres_3)  # -> Meshes, Products, AlignedBox, Frame
glulam_10_bowed_extrusion_guide = TimberPreview(
    Geometry=geometry_32,
    Settings=library_glulam.Settings,
    BasePlane=PlaneXY(0, 0, 0),
    GuideCurve=guide_8,
    Show=show_glulam,
    GeometryUnits=millimetres_3)  # -> Meshes, Products, AlignedBox, Frame
glulam_11_bowed_mesh_guide = TimberPreview(
    Geometry=geometry_33,
    Settings=library_glulam.Settings,
    BasePlane=PlaneXY(0, 0, 0),
    GuideCurve=guide_9,
    Show=show_glulam,
    GeometryUnits=millimetres_3)  # -> Meshes, Products, AlignedBox, Frame

# ---- group: 04 / Product library / Library / CLT
# CLT
# 200 mm · Clean/Pale · 1 mm/pixel
# Material
# Source coordinates
# 01 Solid Brep
# 02 Extrusion
# 03 Surface
# 04 Closed mesh
# 05 Open mesh
# 06 Trimmed + hole
# 07 Bowed surface
# 08 Bowed Brep
# 09 Guided solid
# 10 Guided extrusion
# 11 Guided mesh
millimetres_4 = SourceCoordinateUnits("Millimetres")
geometry_34 = CLT01FlatSolidBrepMatchedLength(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)
geometry_35 = CLT02Extrusion(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)
geometry_36 = CLT03FlatSurface(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)
geometry_37 = CLT04ClosedMesh(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)
geometry_38 = CLT05OpenMesh(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)
geometry_39 = CLT06TrimmedSurfaceWithHole(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)
geometry_40 = CLT07BowedSurfaceAutomatic(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)
geometry_41 = CLT08BowedSingleFaceBrepAutomatic(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)
geometry_42 = CLT09BowedSolidBrepGuide(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)
guide_10 = CLT09BowedSolidBrepGuideGuide(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)
geometry_43 = CLT10BowedExtrusionGuide(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)
guide_11 = CLT10BowedExtrusionGuideGuide(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)
geometry_44 = CLT11BowedMeshGuide(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)
guide_12 = CLT11BowedMeshGuideGuide(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)
library_clt = TimberMaterial(Seed=0, Resolution=1, Advanced=False, PanelExpanded=False, SelectedLook=1, SelectedProduct=0, WoodieMaterialVersion=3)  # -> Settings, Product
show_clt = BooleanToggle(False)
clt_01_flat_solid_brep_matched_length = TimberPreview(Geometry=geometry_34, Settings=library_clt.Settings, Show=show_clt, GeometryUnits=millimetres_4)  # -> Meshes, Products, AlignedBox, Frame
clt_02_extrusion = TimberPreview(Geometry=geometry_35, Settings=library_clt.Settings, Show=show_clt, GeometryUnits=millimetres_4)  # -> Meshes, Products, AlignedBox, Frame
clt_03_flat_surface = TimberPreview(Geometry=geometry_36, Settings=library_clt.Settings, Show=show_clt, GeometryUnits=millimetres_4)  # -> Meshes, Products, AlignedBox, Frame
clt_04_closed_mesh = TimberPreview(Geometry=geometry_37, Settings=library_clt.Settings, Show=show_clt, GeometryUnits=millimetres_4)  # -> Meshes, Products, AlignedBox, Frame
clt_05_open_mesh = TimberPreview(Geometry=geometry_38, Settings=library_clt.Settings, Show=show_clt, GeometryUnits=millimetres_4)  # -> Meshes, Products, AlignedBox, Frame
clt_06_trimmed_surface_with_hole = TimberPreview(Geometry=geometry_39, Settings=library_clt.Settings, Show=show_clt, GeometryUnits=millimetres_4)  # -> Meshes, Products, AlignedBox, Frame
clt_07_bowed_surface_automatic = TimberPreview(Geometry=geometry_40, Settings=library_clt.Settings, Show=show_clt, GeometryUnits=millimetres_4)  # -> Meshes, Products, AlignedBox, Frame
clt_08_bowed_single_face_brep_automatic = TimberPreview(Geometry=geometry_41, Settings=library_clt.Settings, Show=show_clt, GeometryUnits=millimetres_4)  # -> Meshes, Products, AlignedBox, Frame
clt_09_bowed_solid_brep_guide = TimberPreview(
    Geometry=geometry_42,
    Settings=library_clt.Settings,
    BasePlane=PlaneXY(0, 0, 0),
    GuideCurve=guide_10,
    Show=show_clt,
    GeometryUnits=millimetres_4)  # -> Meshes, Products, AlignedBox, Frame
clt_10_bowed_extrusion_guide = TimberPreview(
    Geometry=geometry_43,
    Settings=library_clt.Settings,
    BasePlane=PlaneXY(0, 0, 0),
    GuideCurve=guide_11,
    Show=show_clt,
    GeometryUnits=millimetres_4)  # -> Meshes, Products, AlignedBox, Frame
clt_11_bowed_mesh_guide = TimberPreview(
    Geometry=geometry_44,
    Settings=library_clt.Settings,
    BasePlane=PlaneXY(0, 0, 0),
    GuideCurve=guide_12,
    Show=show_clt,
    GeometryUnits=millimetres_4)  # -> Meshes, Products, AlignedBox, Frame

# ---- group: 04 / Product library / Library / Three-layer panel
# Three-layer panel
# 27 mm · Clean/Pale · 1 mm/pixel
# Material
# Source coordinates
# 01 Solid Brep
# 02 Extrusion
# 03 Surface
# 04 Closed mesh
# 05 Open mesh
# 06 Trimmed + hole
# 07 Bowed surface
# 08 Bowed Brep
# 09 Guided solid
# 10 Guided extrusion
# 11 Guided mesh
millimetres_5 = SourceCoordinateUnits("Millimetres")
geometry_45 = ThreeLayerPanel01FlatSolidBrepMatchedLength(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)
geometry_46 = ThreeLayerPanel02Extrusion(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)
geometry_47 = ThreeLayerPanel03FlatSurface(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)
geometry_48 = ThreeLayerPanel04ClosedMesh(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)
geometry_49 = ThreeLayerPanel05OpenMesh(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)
geometry_50 = ThreeLayerPanel06TrimmedSurfaceWithHole(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)
geometry_51 = ThreeLayerPanel07BowedSurfaceAutomatic(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)
geometry_52 = ThreeLayerPanel08BowedSingleFaceBrepAutomatic(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)
geometry_53 = ThreeLayerPanel09BowedSolidBrepGuide(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)
guide_13 = ThreeLayerPanel09BowedSolidBrepGuideGuide(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)
geometry_54 = ThreeLayerPanel10BowedExtrusionGuide(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)
guide_14 = ThreeLayerPanel10BowedExtrusionGuideGuide(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)
geometry_55 = ThreeLayerPanel11BowedMeshGuide(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)
guide_15 = ThreeLayerPanel11BowedMeshGuideGuide(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)
library_three_layer_panel = TimberMaterial(Seed=0, Resolution=1, Advanced=False, PanelExpanded=False, SelectedLook=1, SelectedProduct=1, WoodieMaterialVersion=3)  # -> Settings, Product
show_three_layer_panel = BooleanToggle(False)
three_layer_panel_01_flat_solid_brep_mat = TimberPreview(
    Geometry=geometry_45,
    Settings=library_three_layer_panel.Settings,
    Show=show_three_layer_panel,
    GeometryUnits=millimetres_5)  # -> Meshes, Products, AlignedBox, Frame; "Three-layer panel / 01 Flat solid Brep (matched length)"
three_layer_panel_02_extrusion = TimberPreview(
    Geometry=geometry_46,
    Settings=library_three_layer_panel.Settings,
    Show=show_three_layer_panel,
    GeometryUnits=millimetres_5)  # -> Meshes, Products, AlignedBox, Frame
three_layer_panel_03_flat_surface = TimberPreview(
    Geometry=geometry_47,
    Settings=library_three_layer_panel.Settings,
    Show=show_three_layer_panel,
    GeometryUnits=millimetres_5)  # -> Meshes, Products, AlignedBox, Frame
three_layer_panel_04_closed_mesh = TimberPreview(
    Geometry=geometry_48,
    Settings=library_three_layer_panel.Settings,
    Show=show_three_layer_panel,
    GeometryUnits=millimetres_5)  # -> Meshes, Products, AlignedBox, Frame
three_layer_panel_05_open_mesh = TimberPreview(
    Geometry=geometry_49,
    Settings=library_three_layer_panel.Settings,
    Show=show_three_layer_panel,
    GeometryUnits=millimetres_5)  # -> Meshes, Products, AlignedBox, Frame
three_layer_panel_06_trimmed_surface_wit = TimberPreview(
    Geometry=geometry_50,
    Settings=library_three_layer_panel.Settings,
    Show=show_three_layer_panel,
    GeometryUnits=millimetres_5)  # -> Meshes, Products, AlignedBox, Frame; "Three-layer panel / 06 Trimmed surface with hole"
three_layer_panel_07_bowed_surface_autom = TimberPreview(
    Geometry=geometry_51,
    Settings=library_three_layer_panel.Settings,
    Show=show_three_layer_panel,
    GeometryUnits=millimetres_5)  # -> Meshes, Products, AlignedBox, Frame; "Three-layer panel / 07 Bowed surface - automatic"
three_layer_panel_08_bowed_single_face_b = TimberPreview(
    Geometry=geometry_52,
    Settings=library_three_layer_panel.Settings,
    Show=show_three_layer_panel,
    GeometryUnits=millimetres_5)  # -> Meshes, Products, AlignedBox, Frame; "Three-layer panel / 08 Bowed single-face Brep - automatic"
three_layer_panel_09_bowed_solid_brep_gu = TimberPreview(
    Geometry=geometry_53,
    Settings=library_three_layer_panel.Settings,
    BasePlane=PlaneXY(0, 0, 0),
    GuideCurve=guide_13,
    Show=show_three_layer_panel,
    GeometryUnits=millimetres_5)  # -> Meshes, Products, AlignedBox, Frame; "Three-layer panel / 09 Bowed solid Brep - guide"
three_layer_panel_10_bowed_extrusion_gui = TimberPreview(
    Geometry=geometry_54,
    Settings=library_three_layer_panel.Settings,
    BasePlane=PlaneXY(0, 0, 0),
    GuideCurve=guide_14,
    Show=show_three_layer_panel,
    GeometryUnits=millimetres_5)  # -> Meshes, Products, AlignedBox, Frame; "Three-layer panel / 10 Bowed extrusion - guide"
three_layer_panel_11_bowed_mesh_guide = TimberPreview(
    Geometry=geometry_55,
    Settings=library_three_layer_panel.Settings,
    BasePlane=PlaneXY(0, 0, 0),
    GuideCurve=guide_15,
    Show=show_three_layer_panel,
    GeometryUnits=millimetres_5)  # -> Meshes, Products, AlignedBox, Frame

# ---- group: 04 / Product library / Library / Plywood
# Plywood
# 18 mm · Clean/Pale · 1 mm/pixel
# Material
# Source coordinates
# 01 Solid Brep
# 02 Extrusion
# 03 Surface
# 04 Closed mesh
# 05 Open mesh
# 06 Trimmed + hole
# 07 Bowed surface
# 08 Bowed Brep
# 09 Guided solid
# 10 Guided extrusion
# 11 Guided mesh
millimetres_6 = SourceCoordinateUnits("Millimetres")
geometry_56 = Plywood01FlatSolidBrepMatchedLength(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)
geometry_57 = Plywood02Extrusion(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)
geometry_58 = Plywood03FlatSurface(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)
geometry_59 = Plywood04ClosedMesh(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)
geometry_60 = Plywood05OpenMesh(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)
geometry_61 = Plywood06TrimmedSurfaceWithHole(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)
geometry_62 = Plywood07BowedSurfaceAutomatic(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)
geometry_63 = Plywood08BowedSingleFaceBrepAutomatic(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)
geometry_64 = Plywood09BowedSolidBrepGuide(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)
guide_16 = Plywood09BowedSolidBrepGuideGuide(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)
geometry_65 = Plywood10BowedExtrusionGuide(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)
guide_17 = Plywood10BowedExtrusionGuideGuide(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)
geometry_66 = Plywood11BowedMeshGuide(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)
guide_18 = Plywood11BowedMeshGuideGuide(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)
library_plywood = TimberMaterial(Seed=0, Resolution=1, Advanced=False, PanelExpanded=False, SelectedLook=1, SelectedProduct=6, WoodieMaterialVersion=3)  # -> Settings, Product
show_plywood = BooleanToggle(False)
plywood_01_flat_solid_brep_matched_lengt = TimberPreview(Geometry=geometry_56, Settings=library_plywood.Settings, Show=show_plywood, GeometryUnits=millimetres_6)  # -> Meshes, Products, AlignedBox, Frame; "Plywood / 01 Flat solid Brep (matched length)"
plywood_02_extrusion = TimberPreview(Geometry=geometry_57, Settings=library_plywood.Settings, Show=show_plywood, GeometryUnits=millimetres_6)  # -> Meshes, Products, AlignedBox, Frame
plywood_03_flat_surface = TimberPreview(Geometry=geometry_58, Settings=library_plywood.Settings, Show=show_plywood, GeometryUnits=millimetres_6)  # -> Meshes, Products, AlignedBox, Frame
plywood_04_closed_mesh = TimberPreview(Geometry=geometry_59, Settings=library_plywood.Settings, Show=show_plywood, GeometryUnits=millimetres_6)  # -> Meshes, Products, AlignedBox, Frame
plywood_05_open_mesh = TimberPreview(Geometry=geometry_60, Settings=library_plywood.Settings, Show=show_plywood, GeometryUnits=millimetres_6)  # -> Meshes, Products, AlignedBox, Frame
plywood_06_trimmed_surface_with_hole = TimberPreview(Geometry=geometry_61, Settings=library_plywood.Settings, Show=show_plywood, GeometryUnits=millimetres_6)  # -> Meshes, Products, AlignedBox, Frame
plywood_07_bowed_surface_automatic = TimberPreview(Geometry=geometry_62, Settings=library_plywood.Settings, Show=show_plywood, GeometryUnits=millimetres_6)  # -> Meshes, Products, AlignedBox, Frame
plywood_08_bowed_single_face_brep_automa = TimberPreview(Geometry=geometry_63, Settings=library_plywood.Settings, Show=show_plywood, GeometryUnits=millimetres_6)  # -> Meshes, Products, AlignedBox, Frame; "Plywood / 08 Bowed single-face Brep - automatic"
plywood_09_bowed_solid_brep_guide = TimberPreview(
    Geometry=geometry_64,
    Settings=library_plywood.Settings,
    BasePlane=PlaneXY(0, 0, 0),
    GuideCurve=guide_16,
    Show=show_plywood,
    GeometryUnits=millimetres_6)  # -> Meshes, Products, AlignedBox, Frame
plywood_10_bowed_extrusion_guide = TimberPreview(
    Geometry=geometry_65,
    Settings=library_plywood.Settings,
    BasePlane=PlaneXY(0, 0, 0),
    GuideCurve=guide_17,
    Show=show_plywood,
    GeometryUnits=millimetres_6)  # -> Meshes, Products, AlignedBox, Frame
plywood_11_bowed_mesh_guide = TimberPreview(
    Geometry=geometry_66,
    Settings=library_plywood.Settings,
    BasePlane=PlaneXY(0, 0, 0),
    GuideCurve=guide_18,
    Show=show_plywood,
    GeometryUnits=millimetres_6)  # -> Meshes, Products, AlignedBox, Frame

# ---- group: 04 / Product library / Library / LVL — parallel
# LVL — parallel
# 45 mm · Clean/Pale · 1 mm/pixel
# Material
# Source coordinates
# 01 Solid Brep
# 02 Extrusion
# 03 Surface
# 04 Closed mesh
# 05 Open mesh
# 06 Trimmed + hole
# 07 Bowed surface
# 08 Bowed Brep
# 09 Guided solid
# 10 Guided extrusion
# 11 Guided mesh
millimetres_7 = SourceCoordinateUnits("Millimetres")
geometry_67 = LVLParallel01FlatSolidBrepMatchedLength(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)
geometry_68 = LVLParallel02Extrusion(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)
geometry_69 = LVLParallel03FlatSurface(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)
geometry_70 = LVLParallel04ClosedMesh(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)
geometry_71 = LVLParallel05OpenMesh(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)
geometry_72 = LVLParallel06TrimmedSurfaceWithHole(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)
geometry_73 = LVLParallel07BowedSurfaceAutomatic(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)
geometry_74 = LVLParallel08BowedSingleFaceBrepAutomatic(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)
geometry_75 = LVLParallel09BowedSolidBrepGuide(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)
guide_19 = LVLParallel09BowedSolidBrepGuideGuide(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)
geometry_76 = LVLParallel10BowedExtrusionGuide(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)
guide_20 = LVLParallel10BowedExtrusionGuideGuide(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)
geometry_77 = LVLParallel11BowedMeshGuide(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)
guide_21 = LVLParallel11BowedMeshGuideGuide(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)
library_lvl_parallel = TimberMaterial(Seed=0, Resolution=1, Advanced=False, PanelExpanded=False, SelectedLook=1, SelectedProduct=7, WoodieMaterialVersion=3)  # -> Settings, Product
show_lvl_parallel = BooleanToggle(False)
lvl_parallel_01_flat_solid_brep_matched = TimberPreview(Geometry=geometry_67, Settings=library_lvl_parallel.Settings, Show=show_lvl_parallel, GeometryUnits=millimetres_7)  # -> Meshes, Products, AlignedBox, Frame; "LVL — parallel / 01 Flat solid Brep (matched length)"
lvl_parallel_02_extrusion = TimberPreview(Geometry=geometry_68, Settings=library_lvl_parallel.Settings, Show=show_lvl_parallel, GeometryUnits=millimetres_7)  # -> Meshes, Products, AlignedBox, Frame
lvl_parallel_03_flat_surface = TimberPreview(Geometry=geometry_69, Settings=library_lvl_parallel.Settings, Show=show_lvl_parallel, GeometryUnits=millimetres_7)  # -> Meshes, Products, AlignedBox, Frame
lvl_parallel_04_closed_mesh = TimberPreview(Geometry=geometry_70, Settings=library_lvl_parallel.Settings, Show=show_lvl_parallel, GeometryUnits=millimetres_7)  # -> Meshes, Products, AlignedBox, Frame
lvl_parallel_05_open_mesh = TimberPreview(Geometry=geometry_71, Settings=library_lvl_parallel.Settings, Show=show_lvl_parallel, GeometryUnits=millimetres_7)  # -> Meshes, Products, AlignedBox, Frame
lvl_parallel_06_trimmed_surface_with_hol = TimberPreview(Geometry=geometry_72, Settings=library_lvl_parallel.Settings, Show=show_lvl_parallel, GeometryUnits=millimetres_7)  # -> Meshes, Products, AlignedBox, Frame; "LVL — parallel / 06 Trimmed surface with hole"
lvl_parallel_07_bowed_surface_automatic = TimberPreview(Geometry=geometry_73, Settings=library_lvl_parallel.Settings, Show=show_lvl_parallel, GeometryUnits=millimetres_7)  # -> Meshes, Products, AlignedBox, Frame
lvl_parallel_08_bowed_single_face_brep_a = TimberPreview(Geometry=geometry_74, Settings=library_lvl_parallel.Settings, Show=show_lvl_parallel, GeometryUnits=millimetres_7)  # -> Meshes, Products, AlignedBox, Frame; "LVL — parallel / 08 Bowed single-face Brep - automatic"
lvl_parallel_09_bowed_solid_brep_guide = TimberPreview(
    Geometry=geometry_75,
    Settings=library_lvl_parallel.Settings,
    BasePlane=PlaneXY(0, 0, 0),
    GuideCurve=guide_19,
    Show=show_lvl_parallel,
    GeometryUnits=millimetres_7)  # -> Meshes, Products, AlignedBox, Frame
lvl_parallel_10_bowed_extrusion_guide = TimberPreview(
    Geometry=geometry_76,
    Settings=library_lvl_parallel.Settings,
    BasePlane=PlaneXY(0, 0, 0),
    GuideCurve=guide_20,
    Show=show_lvl_parallel,
    GeometryUnits=millimetres_7)  # -> Meshes, Products, AlignedBox, Frame
lvl_parallel_11_bowed_mesh_guide = TimberPreview(
    Geometry=geometry_77,
    Settings=library_lvl_parallel.Settings,
    BasePlane=PlaneXY(0, 0, 0),
    GuideCurve=guide_21,
    Show=show_lvl_parallel,
    GeometryUnits=millimetres_7)  # -> Meshes, Products, AlignedBox, Frame

# ---- group: 04 / Product library / Library / Kerto-Q
# Kerto-Q
# 45 mm · Clean/Pale · 1 mm/pixel
# Material
# Source coordinates
# 01 Solid Brep
# 02 Extrusion
# 03 Surface
# 04 Closed mesh
# 05 Open mesh
# 06 Trimmed + hole
# 07 Bowed surface
# 08 Bowed Brep
# 09 Guided solid
# 10 Guided extrusion
# 11 Guided mesh
millimetres_8 = SourceCoordinateUnits("Millimetres")
geometry_78 = KertoQ01FlatSolidBrepMatchedLength(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)
geometry_79 = KertoQ02Extrusion(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)
geometry_80 = KertoQ03FlatSurface(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)
geometry_81 = KertoQ04ClosedMesh(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)
geometry_82 = KertoQ05OpenMesh(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)
geometry_83 = KertoQ06TrimmedSurfaceWithHole(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)
geometry_84 = KertoQ07BowedSurfaceAutomatic(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)
geometry_85 = KertoQ08BowedSingleFaceBrepAutomatic(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)
geometry_86 = KertoQ09BowedSolidBrepGuide(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)
guide_22 = KertoQ09BowedSolidBrepGuideGuide(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)
geometry_87 = KertoQ10BowedExtrusionGuide(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)
guide_23 = KertoQ10BowedExtrusionGuideGuide(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)
geometry_88 = KertoQ11BowedMeshGuide(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)
guide_24 = KertoQ11BowedMeshGuideGuide(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)
library_kerto_q = TimberMaterial(Seed=0, Resolution=1, Advanced=False, PanelExpanded=False, SelectedLook=1, SelectedProduct=3, WoodieMaterialVersion=3)  # -> Settings, Product
show_kerto_q = BooleanToggle(False)
kerto_q_01_flat_solid_brep_matched_lengt = TimberPreview(Geometry=geometry_78, Settings=library_kerto_q.Settings, Show=show_kerto_q, GeometryUnits=millimetres_8)  # -> Meshes, Products, AlignedBox, Frame; "Kerto-Q / 01 Flat solid Brep (matched length)"
kerto_q_02_extrusion = TimberPreview(Geometry=geometry_79, Settings=library_kerto_q.Settings, Show=show_kerto_q, GeometryUnits=millimetres_8)  # -> Meshes, Products, AlignedBox, Frame
kerto_q_03_flat_surface = TimberPreview(Geometry=geometry_80, Settings=library_kerto_q.Settings, Show=show_kerto_q, GeometryUnits=millimetres_8)  # -> Meshes, Products, AlignedBox, Frame
kerto_q_04_closed_mesh = TimberPreview(Geometry=geometry_81, Settings=library_kerto_q.Settings, Show=show_kerto_q, GeometryUnits=millimetres_8)  # -> Meshes, Products, AlignedBox, Frame
kerto_q_05_open_mesh = TimberPreview(Geometry=geometry_82, Settings=library_kerto_q.Settings, Show=show_kerto_q, GeometryUnits=millimetres_8)  # -> Meshes, Products, AlignedBox, Frame
kerto_q_06_trimmed_surface_with_hole = TimberPreview(Geometry=geometry_83, Settings=library_kerto_q.Settings, Show=show_kerto_q, GeometryUnits=millimetres_8)  # -> Meshes, Products, AlignedBox, Frame
kerto_q_07_bowed_surface_automatic = TimberPreview(Geometry=geometry_84, Settings=library_kerto_q.Settings, Show=show_kerto_q, GeometryUnits=millimetres_8)  # -> Meshes, Products, AlignedBox, Frame
kerto_q_08_bowed_single_face_brep_automa = TimberPreview(Geometry=geometry_85, Settings=library_kerto_q.Settings, Show=show_kerto_q, GeometryUnits=millimetres_8)  # -> Meshes, Products, AlignedBox, Frame; "Kerto-Q / 08 Bowed single-face Brep - automatic"
kerto_q_09_bowed_solid_brep_guide = TimberPreview(
    Geometry=geometry_86,
    Settings=library_kerto_q.Settings,
    BasePlane=PlaneXY(0, 0, 0),
    GuideCurve=guide_22,
    Show=show_kerto_q,
    GeometryUnits=millimetres_8)  # -> Meshes, Products, AlignedBox, Frame
kerto_q_10_bowed_extrusion_guide = TimberPreview(
    Geometry=geometry_87,
    Settings=library_kerto_q.Settings,
    BasePlane=PlaneXY(0, 0, 0),
    GuideCurve=guide_23,
    Show=show_kerto_q,
    GeometryUnits=millimetres_8)  # -> Meshes, Products, AlignedBox, Frame
kerto_q_11_bowed_mesh_guide = TimberPreview(
    Geometry=geometry_88,
    Settings=library_kerto_q.Settings,
    BasePlane=PlaneXY(0, 0, 0),
    GuideCurve=guide_24,
    Show=show_kerto_q,
    GeometryUnits=millimetres_8)  # -> Meshes, Products, AlignedBox, Frame

# ---- group: 06 / Natural bamboo
# 06 / NATURAL BAMBOO
# Natural Stock with Kind=Bamboo builds a hollow Moso culm on a Line from base to tip (Ø 80 · wall 7 · 1500 mm).
# Wire Stock Model to Timber Preview Stock for texture. Natural Stock alone shows the culm solid.
culm_material = TimberMaterial(Seed=3, Resolution=8, Advanced=False, PanelExpanded=False, SelectedLook=0, SelectedProduct=5, WoodieMaterialVersion=3)  # -> Settings, Product
bamboo_culm = NaturalStock(
    Line=Line((2800, 4500, 0), (2800, 4500, 1500)),
    Kind="Bamboo",
    Settings=culm_material.Settings,
    GeometryUnits="Millimetres")  # -> StockModel, Geometry
culm_geometry = Geometry(bamboo_culm.Geometry)
